# Grasshopper definition a01_GeoOpt.gh (Grasshopper 1.0.7)

# Basel Ghazaly
# 1. list
series = Series(Start=0, Step=1, Count=Slider(10, range=0..10))

# ---- group: 1.
# 2. points
pt = ConstructPoint(XCoordinate=series, YCoordinate=0, ZCoordinate=0)

# ----
construct_point = ConstructPoint(XCoordinate=series, YCoordinate=Slider(10, range=0..10), ZCoordinate=0)
# pseudo-code with hints
python = GhPythonScript(x=Slider(10, range=0..10), y=Slider(10, range=0..10), u=Slider(10, range=0..10), v=Slider(10, range=0..10))  # -> out, a, b, c, d, e, f, g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; inputs x: Int32, y: Int32, u: Int32, v: Int32
# ---------- python: Python ----------
#you will need all this libraries
import Rhino.Geometry as rg
import ghpythonlib.treehelpers as th #this one is to import nested lists to grasshopper trees
import math


#----------------------------------------------------------
#1.- create first series of points -
#start by initializing an empty list and fill it with points 
#by creating points with a for loop. The number of points should come 
#from a grasshopper slider
#Increment the X coordinate of the point at each iteration so to create
#a series of points along the X axis line
#store that point to the list
#output this list to grasshopper to verify the result should look like gh component (1.)

pointList1 = []

for i in range(x):
    pt = rg.Point3d(i,0,0)
    pointList1.append(pt)

a = pointList1

#----------------------------------------------------------
#2. - create second series of points -
#create a second list of points  by copying the code above, but this time
#assign the Y coordinate of each point to a value that comes from an 
#external input which can be a slider in grasshopper
#output that list as well, the result should look like component (2.) 

pointList2 = []

for i in range(x):
    pt = rg.Point3d(i,y,0)
    pointList2.append(pt)

b = pointList2


#----------------------------------------------------------
#3. - create lines from two serie of points - 
#initialize another empty list to store some lines
#make another for loop that iterates through each point in any of the list BY INDEX
#within this loop, make a line that draws from points in both lists with the same index
#and append that line to the line list. output the result
#hint: you only need one for loop for this

lineList = []

indexes = range(x)

for i in indexes:
    l = rg.Line(pointList1[i],pointList2[i])
    lineList.append(l)

c = lineList

#----------------------------------------------------------
#4.- divide curve -
#initialize another empty list to store some curves
#interate through every line in the line list with a for loop 
#inside the scope of this for loop, create an empty list to store the division points
#inside the for loop, convert each line to a nurbs curve, like shown in class
#divide the new curve into 10 points by applying DivideByCount() method (see rhinocommo) and store the result
#this returns a list of parameters in the line which correspond to each parameter
#you need to iterate through the list of params with another for loop and get the point per each param 
#using Line.PointAt(), and there the points in the list of divison points

allDivPts = [] #this will be a list of lists
for line in lineList:
    linePts =[] #create an empty list to fill each iteration
    #ncrv = line.ToNurbsCurve()
    #print(ncrv.Domain)
    for j in range(11):
        divPt = line.PointAt(j/10)
        linePts.append(divPt)
        #
    #here you return to the scope of the first for loop
    allDivPts.append(linePts) #append the list of points PER LINE to another list

d = th.list_to_tree(allDivPts) #this is how you output nested lists to gh trees

#----------------------------------------------------------
#5.- apply sine function to points
#here we will use the sin() the math library to move the points in Z, 
#it makes sense to follow the logic of group 5. of gh components
#first, create a nested for loop to iterate the nested list by index (I´ve done that for you)
#second, transfor the pt to a vector3d
#third, get the vector length (it´s one of it´s properties)
#forth, create a variable that will be the magnitude of displacement, by passign the vector length to the math.sin() function
#fifth, create another 3d vector, which is is the Z vector times the previous variable
#sixth, get a new point by substracting the point to the vector (literally, a point - a vector results in another point)
#finally, append that point to a list, and then append that list to the nested list


allMovedPts = [] #list of all moved points
for list in allDivPts:
    movedPts= [] #list of moved points
    
    for pt in list:
        vec = rg.Vector3d(pt)
        vec_len = vec.Length
        #print vec_len
        zvec = math.sin(vec_len)
        #print zvec
        newPt = rg.Point3d(pt.X, pt.Y, (-zvec))
        #print nvec
        #print type(nvec)
        #newPt = pt - nvec #Subtrcating didn't work (it won't work here but I had the right code for it before I changed it to make point instead)
        
        movedPts.append(newPt)
    allMovedPts.append(movedPts)

d = th.list_to_tree(allMovedPts) #output list of list to gh

#----------------------------------------------------------
#6.- make a curve from a list of points
#again, initialize an empty list which will contain curves
#interate through the list of list of points with a for loop
#create a curve with rg.Curve.CreateInterpolatedCurve() as in 6. (see rhinocommon)
#append that curve to the list of curves and output it to gh

#make a curve from list of points
curveList = []

for pointlist in allMovedPts:
    crv = rg.Curve.CreateInterpolatedCurve(pointlist,3)
    curveList.append(crv)

e= curveList

#----------------------------------------------------------
# 7.- create a loft surface from curves
#use rg.Brep.CreateFromLoft() (see rc) to create a surface from loft
#store it in a variable and output it to gh

import rhinoscriptsyntax as rs

surface = rg.Brep.CreateFromLoft(curveList, rg.Point3d.Unset, rg.Point3d.Unset, rg.LoftType.Normal, False)
f = surface

#print surface
#print type(surface)
#print type(surface[0])

#----------------------------------------------------------
#8.- create a mesh from Brep
#The last step is to create a mesh from a Brep using rg.Mesh.CreateFromBrep(), store it and output it to gh
#keep in mind that CreateFromBrep needs one Brep and CreateFromLoft() returns a list (even if only of one element)

mesh = rg.Mesh.CreateFromBrep(surface[0], rg.MeshingParameters(0.5))
g = mesh
#print mesh
#print type(mesh)
#print type(mesh[0])

surface1 = rs.AddLoftSrf(curveList)
f = surface1
#make rs readable in rhinocommon
surface1 = rs.coercesurface(surface1)

#Divide surface Domain
rg.Surface.SetDomain(surface1, 0 ,rg.Interval(0,u))
rg.Surface.SetDomain(surface1, 1 ,rg.Interval(0,v))
pts = []
for i in range(u+1):
    for j in range(v+1):
        pt = rg.Surface.PointAt(surface1, i, j)
        pts.append(pt)
h = pts

#Grafting the point list

grafted_pts = []
for i in range (0,len(pts),v+1):
    sublist= []
    for j in range(v+1):
        point = pts[i+j]
        sublist.append(point)
    grafted_pts.append(sublist)

i = th.list_to_tree(grafted_pts)

#segments 1
seglines1 = []
for i in range(len(grafted_pts)):
    for j in range(len(grafted_pts[i])-1): #?
        line = rg.Line(grafted_pts[i][j], grafted_pts[i][j+1])
        curve = rg.Line.ToNurbsCurve(line)
        seglines1.append(curve)
j = seglines1

#segments 2
seglines2 = []
for i in range(len(grafted_pts)-1):
    for j in range(len(grafted_pts[i])):
        line = rg.Line(grafted_pts[i][j], grafted_pts[i+1][j])
        curve = rg.Line.ToNurbsCurve(line)
        seglines2.append(curve)
k = seglines2

allsegs = seglines2
allsegs.extend(seglines1)


from System.Collections.Generic import List
all = List[rg.Curve](allsegs)
all = all.ToArray() #not poping up

Mesh = rg.Mesh.CreateFromLines(all,4,0.001)

l = Mesh
"""

#subBrep = surface[0]
#subSurface = subBrep[0]
#print subBrep
#print subSurface


pts = {}
srfs = []
grid = []

nrows = 15
ncolumns = 15

UDomain = rg.Interval(0,15)
VDomain = rg.Interval(0,15)
surface.SetDomain(0, UDomain)
surface.SetDomain(1, VDomain)

for i in range(0,nrows+1):
    gcolumn = []
    for j in range(0,ncolumns+1):
        pts[(i,j)] = rg.Surface.PointAt(surface,i,j)
        gcolumn.append(rg.Surface.PointAt(surface,i,j))
    grid.append(gcolumn)
  
for i in range(0, nrows):
    pcolumn = []
    for j in range(0, ncolumns):
        panel = rg.NurbsSurface.CreateFromCorners(pts[i,j],pts[i+1,j],pts[i+1,j+1],pts[i,j+1])
        pcolumn.append(panel)
        srfs.append(pcolumn)
    
    srfs = th.list_to_tree(srfs)
    grid = th.list_to_tree(grid)



# Divide surface using UV



# Graft divsion points accordig to U or V



#Draw segments between these points to get result like in CURVES 
#they should be curves, so you shall convert lines to curves



#Draw mesh using rg.Mesh.CreateFromLines
#You can set max valence to 4


#Notice that rg.Mesh.CreateFromLines accepts array of curves
#not a list of curves, so you may need to convert the curves list to array 


#THE END
"""
# ---------- end python ----------
python_2 = GhPythonScript(x=Slider(10, range=0..10), y=Slider(10, range=0..10), u=Slider(10, range=0..10), v=Slider(10, range=0..10))  # -> out, a, b, c, d, e, f, g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; inputs x: Int32, y: Int32, u: Int32, v: Int32
# ---------- python_2: Python ----------
#you will need all this libraries
import Rhino.Geometry as rg
import ghpythonlib.treehelpers as th #this one is to import nested lists to grasshopper trees
import math


#----------------------------------------------------------
#1.- create first series of points -
#start by initializing an empty list and fill it with points 
#by creating points with a for loop. The number of points should come 
#from a grasshopper slider
#Increment the X coordinate of the point at each iteration so to create
#a series of points along the X axis line
#store that point to the list
#output this list to grasshopper to verify the result should look like gh component (1.)

pointList1 = []

for i in range(x):
    pt = rg.Point3d(i,0,0)
    pointList1.append(pt)

a = pointList1

#----------------------------------------------------------
#2. - create second series of points -
#create a second list of points  by copying the code above, but this time
#assign the Y coordinate of each point to a value that comes from an 
#external input which can be a slider in grasshopper
#output that list as well, the result should look like component (2.) 

pointList2 = []

for i in range(x):
    pt = rg.Point3d(i,y,0)
    pointList2.append(pt)

b = pointList2


#----------------------------------------------------------
#3. - create lines from two serie of points - 
#initialize another empty list to store some lines
#make another for loop that iterates through each point in any of the list BY INDEX
#within this loop, make a line that draws from points in both lists with the same index
#and append that line to the line list. output the result
#hint: you only need one for loop for this

lineList = []

indexes = range(x)

for i in indexes:
    l = rg.Line(pointList1[i],pointList2[i])
    lineList.append(l)

c = lineList

#----------------------------------------------------------
#4.- divide curve -
#initialize another empty list to store some curves
#interate through every line in the line list with a for loop 
#inside the scope of this for loop, create an empty list to store the division points
#inside the for loop, convert each line to a nurbs curve, like shown in class
#divide the new curve into 10 points by applying DivideByCount() method (see rhinocommo) and store the result
#this returns a list of parameters in the line which correspond to each parameter
#you need to iterate through the list of params with another for loop and get the point per each param 
#using Line.PointAt(), and there the points in the list of divison points

allDivPts = [] #this will be a list of lists
for line in lineList:
    linePts =[] #create an empty list to fill each iteration
    #ncrv = line.ToNurbsCurve()
    #print(ncrv.Domain)
    for j in range(11):
        divPt = line.PointAt(j/10)
        linePts.append(divPt)
        #
    #here you return to the scope of the first for loop
    allDivPts.append(linePts) #append the list of points PER LINE to another list

d = th.list_to_tree(allDivPts) #this is how you output nested lists to gh trees

#----------------------------------------------------------
#5.- apply sine function to points
#here we will use the sin() the math library to move the points in Z, 
#it makes sense to follow the logic of group 5. of gh components
#first, create a nested for loop to iterate the nested list by index (I´ve done that for you)
#second, transfor the pt to a vector3d
#third, get the vector length (it´s one of it´s properties)
#forth, create a variable that will be the magnitude of displacement, by passign the vector length to the math.sin() function
#fifth, create another 3d vector, which is is the Z vector times the previous variable
#sixth, get a new point by substracting the point to the vector (literally, a point - a vector results in another point)
#finally, append that point to a list, and then append that list to the nested list


allMovedPts = [] #list of all moved points
for list in allDivPts:
    movedPts= [] #list of moved points
    
    for pt in list:
        vec = rg.Vector3d(pt)
        vec_len = vec.Length
        #print vec_len
        zvec = math.sin(vec_len)
        #print zvec
        newPt = rg.Point3d(pt.X, pt.Y, (-zvec))
        #print nvec
        #print type(nvec)
        #newPt = pt - nvec #Subtrcating didn't work (it won't work here but I had the right code for it before I changed it to make point instead)
        
        movedPts.append(newPt)
    allMovedPts.append(movedPts)

d = th.list_to_tree(allMovedPts) #output list of list to gh

#----------------------------------------------------------
#6.- make a curve from a list of points
#again, initialize an empty list which will contain curves
#interate through the list of list of points with a for loop
#create a curve with rg.Curve.CreateInterpolatedCurve() as in 6. (see rhinocommon)
#append that curve to the list of curves and output it to gh

#make a curve from list of points
curveList = []

for pointlist in allMovedPts:
    crv = rg.Curve.CreateInterpolatedCurve(pointlist,3)
    curveList.append(crv)

e= curveList

#----------------------------------------------------------
# 7.- create a loft surface from curves
#use rg.Brep.CreateFromLoft() (see rc) to create a surface from loft
#store it in a variable and output it to gh

import rhinoscriptsyntax as rs

surface = rg.Brep.CreateFromLoft(curveList, rg.Point3d.Unset, rg.Point3d.Unset, rg.LoftType.Normal, False)
f = surface

#print surface
#print type(surface)
#print type(surface[0])

#----------------------------------------------------------
#David's Approach

sorted_points = []

flattenlist = []

for ptlist in allMovedPts:
    for pts in ptlist:
        flattenlist.append(pts)

for i in range(len(flattenlist)-(v+2)):
    sub = []
    if (i != v and ((i-v) % (i+v) != 0) or i==0):
        for j in range(1):
            point1 = flattenlist[i]
            point2 = flattenlist[i+1]            
            point3 = flattenlist[i+v+1]
            point4 = flattenlist[i+v+2]
            sub.extend([point1,point2,point3,point4]) #why not append
        sorted_points.append(sub)
print sorted_points
m = th.list_to_tree(sorted_points)
#THE END
# ---------- end python_2 ----------
point_list_1 = Data(python.a)
point_list_2 = Data(python.b)
lines = Data(python.c)
moved_points = Data(python.d)
nurbs_curve = Data(python.e)
brep = Data(python.f)
mesh = Data(python.g)
mesh_pts = Data(python.h)
grafted_pts = Data(python.i)
point_list_1_2 = Data(python_2.a)
point_list_2_2 = Data(python_2.b)
lines_2 = Data(python_2.c)
moved_points_2 = Data(python_2.d)
nurbs_curve_2 = Data(python_2.e)
brep_2 = Data(python_2.f)
mesh_2 = Data(python_2.g)
mesh_pts_2 = Data(python_2.h)
grafted_pts_2 = Data(python_2.i)
lines_1 = Data(python.j)
lines_2_2 = Data(python.k)
mesh_3 = Data(python.l)
lines_1_2 = Data(python_2.j)
lines_2_3 = Data(python_2.k)
mesh_4 = Data(python_2.l)

# ---- group: 3.
# 3. line
ln = Line(StartPoint=pt, EndPoint=construct_point)

# ----
points = PointList(Points=mesh_pts)
points_2 = PointList(Points=grafted_pts)
panel = Panel(grafted_pts)
points_3 = PointList(Points=mesh_pts_2)
points_4 = PointList(Points=grafted_pts_2)
panel_2 = Panel(grafted_pts_2)

# ---- group: Not a uniform mesh
demesh = DeconstructMesh(Mesh=mesh)  # -> Vertices, Faces, Colours, Normals

# ----
demesh_2 = DeconstructMesh(Mesh=mesh_2)  # -> Vertices, Faces, Colours, Normals

# ---- group: 4.
# 4. divide curve
divide = DivideCurve(Curve=ln, Count=10, Kinks=False)  # -> Points, Tangents, Parameters

# ---- group: 5.
vec = Vector(divide.Points)
vlen = VectorLength(Vector=vec)
sin = Sine(Value=vlen)
Z = UnitZ(Factor=sin)
# 5. vector
move = Move(Geometry=divide.Points, Motion=Z)  # -> Geometry, Transform

# ----
path = FilePath("E:\IAAC\AIA\AIA_S3_ Digital Tools for Algorithmic Geometrical Optimization\Geo-Opt\a01\GeoOpt\a01\GeOpt-a01-Basel.py")
pt_2 = Point([Point(1, 2, 0), Point(1, 9, 0), Point(9, 9, 0), Point(9, 2, 0)])
file = ReadFile(File=path, PerLineParse=False)
panel_3 = Panel(file)
python_3 = GhPythonScript(Code=file, Pts=pt_2)  # -> Out, A, B, C
python_4 = GhPythonScript(pts=pt_2)  # -> out, a, b, c; inputs pts: list of Point3d
# ---------- python_4: Python ----------
import Rhino.Geometry as rg

#create mesh
mesh = rg.Mesh()

#list of vertices
print len(mesh.Vertices)

#add vertices to list
for p in pts:
    mesh.Vertices.Add(p)
    
print len(mesh.Vertices)
b = mesh.Vertices

#list of faces
print len(mesh.Faces)

#add faces to list
mesh.Faces.AddFace(0,1,2,3)

a = mesh
# ---------- end python_4 ----------
points_5 = PointList(Points=python_4.b)

# ---- group: 6.
# 6. curve
intcrv = Interpolate(Vertices=move.Geometry, Degree=3, Periodic=False, KnotStyle=1)  # -> Curve, Length, Domain

# ---- group: 7.
# 7. surface
loft = Loft(
    Curves=flatten(intcrv.Curve),
    Options={Adjust=False, Closed=False, LoftEnds=0, LoftSimp=0, LoftType=0, Rebuild=10, Refit=0.01})

# ---- group: 8.
# 8. mesh
mesh_uv = MeshSurface(Surface=loft, UCount=Slider(10, range=0..10), VCount=Slider(7, range=0..10), Overhang=True, Equalize=False)
