# Grasshopper definition Basel_AIA_GeoOpt_Assignment02_setup.gh (Grasshopper 1.0.7)

# Assignment 2
python = GhPythonScript(x=Slider(10, range=1..20), y=Slider(10, range=1..20), U=Slider(20, range=1..20), V=Slider(20, range=1..20))  # -> out, a, c, d, e, f, g, h; inputs x: Int32, U: Int32, V: Int32
# ---------- python: Python ----------
import Rhino.Geometry as rg
import ghpythonlib.treehelpers as th
import math
import ghpythonlib.components as ghc

#this is how you initialize a list in python
pointList1 = []
pointList2 = []
for i in range(x):
    pt1 = rg.Point3d(i, 0, 0)
    pt2 = rg.Point3d(i, y, 0)
    pointList1.append(pt1)
    pointList2.append(pt2)

a = pointList1

lineList = []
for i in range(len(pointList1)):
    line = rg.Line(pointList1[i], pointList2[i])
    lineList.append(line)
c = lineList


allDivPts = []
for l in lineList:
    divPts = [] #my list of division points
    nc = l.ToNurbsCurve()
    params = nc.DivideByCount(V, True)
    for p in params:
        divPt = nc.PointAt(p)
        
        vec= rg.Vector3d(divPt)
        vecLen = vec.Length
        mag = math.sin(vecLen)
        transVec = -rg.Vector3d.ZAxis * mag
        
        newPt = divPt - transVec
        divPts.append(newPt)

    allDivPts.append(divPts)

d = th.list_to_tree(allDivPts)


#make a curve from list of points
curveList = []
for i in range(len(allDivPts)):
    curve = rg.Curve.CreateInterpolatedCurve(allDivPts[i], 3)
    curveList.append(curve)
e= curveList


#create a loft surface from curves
surface = rg.Brep.CreateFromLoft(curveList, rg.Point3d.Unset, rg.Point3d.Unset, rg.LoftType.Normal, False)
surface = surface[0].Faces[0]

f = surface

#reparametrize surface
surface.SetDomain(0,rg.Interval(0,U))
surface.SetDomain(1,rg.Interval(0,V))

#get points
allSrfPts=[]
for i in range(U+1):
    srfPts= []
    for j in range(V+1):
        pt=rg.Surface.PointAt(surface,i,j)
        srfPts.append(pt)
    allSrfPts.append(srfPts)
h = allSrfPts


mesh = rg.Mesh()
for i in range(len(allSrfPts)-1):
    for j in range(len(allSrfPts[i])-1):
        m = rg.Mesh()
        v1 = allSrfPts[i][j]
        v2 = allSrfPts[i][j+1]        
        v3 = allSrfPts[i+1][j+1]        
        v4 = allSrfPts[i+1][j]
        
        m.Vertices.Add(v1)
        m.Vertices.Add(v2)
        m.Vertices.Add(v3)
        m.Vertices.Add(v4)
        
        m.Faces.AddFace(0,1,2,3)
        
        mesh.Append(m)

g = mesh

cleanmesh = mesh
#methods to clean a mesh
cleanmesh.Normals.ComputeNormals()
cleanmesh.Vertices.CombineIdentical(True, True)
cleanmesh.Vertices.CullUnused()
cleanmesh.Weld(3.14159265358979)
cleanmesh.UnifyNormals()
cleanmesh.FaceNormals.ComputeFaceNormals()
cleanmesh.Compact()


h = cleanmesh
# ---------- end python ----------

# ---- group: create sun Vector
python_2 = GhPythonScript(x=Slider(0.3, range=0..1), y=Slider(0.69, range=0..1))  # -> out, a, b, c
# ---------- python_2: Python ----------
import Rhino.Geometry as rg
import math

#create a sun vector

#1. create a Sphere at point (0,0,0) with radius 1 and output it to a
#output the sphere to a

cpt = rg.Point3d(0,0,0)
sphere = rg.Sphere(cpt,1)

a = sphere

#2. evaluate a point in the sphere using rg.Sphere.PointAt() at coordintes x and y
#the point should only be on the upper half of the sphere (upper hemisphere)
#the angles are in radians, so you might want to use math.pi for this
#output the point to b

point = a.PointAt (x*2*math.pi,y*math.pi)

b = point

#create a vector from the origin  and reverse the vector
#keep in mind that Reverse affects the original vector
#output the vector to c

vec = rg.Vector3d(point)
vec.Reverse()

c = vec
# ---------- end python_2 ----------

# ---- group: replaceable mesh
mesh = Data(python.h)

# ----
python_3 = GhPythonScript(x=python.h)  # -> out, a; unedited script template

# ---- group: your .py file goes here
path = FilePath("E:\IAAC\AIA\AIA_S3_ Digital Tools for Algorithmic Geometrical Optimization\Geo-Opt\a01\GeoOpt\a02\a02.py")

# ----
data = Data(python_2.a)
vdis = VectorDisplay(Anchor=python_2.b, Vector=python_2.c)
file = ReadFile(File=path, PerLineParse=False)
python_4 = GhPythonScript(m=mesh, s=python_2.c, max_r=Slider(0.2, range=0..1), min_r=Slider(0.01, range=0..1))  # -> out, a, b, c, d, e, f, g, h; inputs m: Mesh, s: Vector3d
# ---------- python_4: Python ----------
"""Provides a scripting component.
    Inputs:
        m: a mesh
        s: sun vector
    Output:
        a: List of Vectors
        b: List of Points
        c: list of angles
        d: exploded mesh
        """
        
import Rhino.Geometry as rg

#1.
#compute face normals using rg.Mesh.FaceNormals.ComputeFaceNormals()
#output the vectors to a


m.FaceNormals.ComputeFaceNormals()
faceNormals = m.FaceNormals

reversedNormals = []



for v in faceNormals:
    r = v.Reverse()
    reversedNormals.append(r)

a = faceNormals


#2.
#get the centers of each faces using rg.Mesh.Faces.GetFaceCenter()
#store the centers into a list called centers 
#output that list to b

centers = []

for face in range(len(faceNormals)):
    center = m.Faces.GetFaceCenter(face)
    centers.append(center)
    

b = centers

#3.
#calculate the angle between the sun and each FaceNormal using rg.Vector3d.VectorAngle()
#store the angles in a list called angleList and output it to c

angleList = []

for i in range(len(faceNormals)):
    ang = rg.Vector3d.VectorAngle(s,faceNormals[i])
    angleList.append(ang)

c = angleList

#print(angleList)

#4. explode the mesh - convert each face of the mesh into a mesh
#for this, you have to first copy the mesh using rg.Mesh.Duplicate()
#then iterate through each face of the copy, extract it using rg.Mesh.ExtractFaces
#and store the result into a list called exploded in output d

exploded = []
meshcopy = rg.Mesh.Duplicate(m)

for i in range(len(meshcopy.Faces)):
    ex_faces = meshcopy.Faces.ExtractFaces([0])
    exploded.append(ex_faces)

d = exploded

#after here, your task is to apply a transformation to each face of the mesh
#the transformation should correspond to the angle value that corresponds that face to it... 
#the result should be a mesh that responds to the sun position... its up to you!

#Boundary of each face's mesh
boundary = []
for i in exploded:
    bound = rg.Mesh.GetNakedEdges(i)
    boundary.append(bound)
#e = boundary #How to shoe polyines

#join boundary
jboundary = []
for i in boundary:
    crvs = []
    for j in i:
        crv = rg.Polyline.ToNurbsCurve(j)
        crvs.append(crv)
    jbound = rg.Curve.JoinCurves(crvs)[0]
    jboundary.append(jbound)

e = jboundary

#Remapangles
reangles = []

for i in angleList:
    re = ( ( (i - min(angleList)) * (max_r - min_r)) / (max(angleList) - min(angleList))  + min_r)
    reangles.append(re)

#print reangles
#re = ( (old value - old min ) / (old max - old min) * (newmax - new min) + new min

# Drawing circles
circles = []
for i in range(len(centers)):
    circle = rg.Circle(centers[i],reangles[i])
    circles.append(circle)

f = circles

#project circle
projCircles = []

for i in range(len(circles)):
    crv = rg.Circle.ToNurbsCurve(circles[i])
    project = rg.Curve.ProjectToMesh(crv,exploded[i], rg.Vector3d.ZAxis,0.01)[0]
    projCircles.append(project)

g = projCircles

    
# loft
pts=[]
lofted=[]
for i in range(len(projCircles)):
    crv = projCircles[i]
    p = crv.PointAt(0)
    rg.Curve.DoDirectionsMatch (jboundary[i], crv)
    t = rg.PolyCurve.ClosestPoint (jboundary[i], p, 4)[1]
    rg.Curve.ChangeClosedCurveSeam (jboundary[i], t)
    l = [crv,jboundary[i]]
    loft = rg.Brep.CreateFromLoft(l,rg.Point3d.Unset,rg.Point3d.Unset,rg.LoftType.Normal,False)[0]
    lofted.append(loft)

h = lofted
# ---------- end python_4 ----------
data_2 = Data(python_4.g)
data_3 = Data(python_4.h)
data_4 = Data(python_4.f)
bnd = Bounds(Numbers=python_4.c)
panel = Panel(python_4.out)
dedomain = DeconstructDomain(Domain=bnd)  # -> Start, End
gradient = Gradient(
    LowerLimit=dedomain.Start,
    UpperLimit=dedomain.End,
    Parameter=python_4.c,
    stops=[0: RGB(234, 38, 0), 0.25: RGB(234, 126, 0), 0.5: RGB(254, 244, 84), 0.75: RGB(173, 203, 249), 1: RGB(75, 107, 169)])
vdis_2 = VectorDisplay(Anchor=python_4.b, Vector=python_4.a)
preview = CustomPreview(Geometry=python_4.d, Material=gradient)
preview_2 = CustomPreview(Geometry=data_3, Material=gradient)
